# Grasshopper definition algorithm.gh (Grasshopper 1.0.4)

# ---- group: input
pd = Slider(68, range=65..70)
lens = Geometry(<curve referenced from the Rhino model>)

# ---- group: create groove
end = EndPoints(Curve=lens)  # -> Start, End
lens_groove_point_1 = Geometry(end.Start)
number = Number(1)
number_2 = Number(-1)
Z = UnitZ(Factor=number)
Z_2 = UnitZ(Factor=number_2)
move = Move(Geometry=lens_groove_point_1, Motion=Z_2)  # -> Geometry, Transform
move_2 = Move(Geometry=lens_groove_point_1, Motion=Z)  # -> Geometry, Transform
number_3 = Number(1)
number_4 = Number(1)
Y = UnitY(Factor=number_4)
Y_2 = UnitY(Factor=number_3)
move_3 = Move(Geometry=move_2.Geometry, Motion=Y)  # -> Geometry, Transform
move_4 = Move(Geometry=move.Geometry, Motion=Y_2)  # -> Geometry, Transform
lens_groove_point_2 = Geometry(move_4.Geometry)
lens_groove_point_3 = Geometry(move_3.Geometry)
polyline = PolyLine(Vertices=[lens_groove_point_2, lens_groove_point_1, lens_groove_point_3], Closed=False)
groove_line_for_lens = Geometry(polyline)
swp1 = Sweep1(Rail=lens, Sections=groove_line_for_lens, Miter=1)
groove_surface = Geometry(swp1)

# ---- group: center lens
connect = ConnectCurves(Curves=lens, Continuity=2, Close=True, Bulge=1)
closed_lens = Geometry(connect)
area = Area(Geometry=closed_lens)  # -> Area, Centroid
centerpoint = Point(area.Centroid)
pdecon = Deconstruct(Point=centerpoint)  # -> XComponent, YComponent, ZComponent
number_5 = Number(-1)
number_6 = Number(-1)
multiplication = Multiplication(A=pdecon.YComponent, B=number_5)
multiplication_2 = Multiplication(A=number_6, B=pdecon.XComponent)
Y_3 = UnitY(Factor=multiplication)
X = UnitX(Factor=multiplication_2)
move_5 = Move(Geometry=groove_surface, Motion=X)  # -> Geometry, Transform
move_6 = Move(Geometry=move_5.Geometry, Motion=Y_3)  # -> Geometry, Transform
centered_groove_surface = Geometry(move_6.Geometry)

# ---- group: move and mirror
_2 = Number(2)
division = Division(A=pd, B=_2)
X_2 = UnitX(Factor=division)
move_7 = Move(Geometry=centered_groove_surface, Motion=X_2)  # -> Geometry, Transform
mirror = Mirror(Geometry=move_7.Geometry, Plane=PlaneYZ(0, 0, 0))  # -> Geometry, Transform
two_lenses = Geometry([mirror.Geometry, move_7.Geometry])
